# Grasshopper definition python script trial.gh (Grasshopper 1.0.7)

cir = Circle(Plane=PlaneXY(0, 0, 0), Radius=Slider(20, range=0..100))
divide = DivideCurve(Curve=cir, Count=10, Kinks=False)  # -> Points, Tangents, Parameters
pdecon = Deconstruct(Point=divide.Points)  # -> XComponent, YComponent, ZComponent
python = GhPythonScript(x=pdecon.XComponent, y=pdecon.YComponent, z=Slider(7, range=0..20))  # -> flatten(out), a, b; inputs x: list, y: list
# ---------- python: Python ----------
import rhinoscriptsyntax as rs
import math

a=[]
b=[]
length=len(x)


for i in range(0,length,3):
    for c in range(0,2,1):
        a=6*math.sin(c)
        print(a)
# ---------- end python ----------
cir_2 = Circle(Plane=PlaneXY(0, 0, 0), Radius=1)
pt = ConstructPoint(XCoordinate=pdecon.XComponent, YCoordinate=pdecon.YComponent, ZCoordinate=flatten(python.out))
intcrv = Interpolate(Vertices=pt, Degree=3, Periodic=invert(False), KnotStyle=1)  # -> Curve, Length, Domain
python_2 = GhPythonScript(x=cir_2, y=python.a)  # -> out, a, b, c; inputs y: Int32
# ---------- python_2: Python ----------
import rhinoscriptsyntax as rs

a=[]
c=[]
b=[]


i=0
k=0

for l in range(y,10,1):
    pt=rs.AddPoint(0,0,l)
    e=rs.MoveObject(x,pt)
    b.append(e)
# ---------- end python_2 ----------
pipe = Pipe(Curve=intcrv.Curve, Radius=1, Caps=0)
number_slider = Slider(3, range=0..10)
crv = Curve(python_2.c)
pop2d = Populate2D(Region={Plane=PlaneXY(0, 0, 0), Size=Domain2(u=0..20, v=0..10)}, Count=100, Seed=1)
number_slider_2 = Slider(2, range=0..10)
python_3 = GhPythonScript(x=pop2d)  # -> out, a, b
#   port x: The original line. (Line)
#   port y: The the number of subdivisions. (int)
#   port b: The list of radii. (list of float)
# ---------- python_3: Python ----------
"""
Creates Voronoi cells using Grasshopper functionality.
    Inputs:
        points: The Voronoi cell center points. (Point3d hint, List Access)
    Outputs:
        a: The Voronoi diagram computed by Grasshopper.
"""

# See http://stevebaer.wordpress.com/2013/12/12/ghpython-outside-the-canvas/
# Steve Baer's blog post for more information about this functionality
# Set input to Point3d hint, and List Access, and give it the 'points' name
# to make the example work

import ghpythonlib.components as ghcomp

# call Voronoi component with input points
a = ghcomp.Voronoi(x)
# ---------- end python_3 ----------
area = Area()  # -> Area, Centroid
panel = Panel("1")
number_slider_3 = Slider(1, range=0..1)
python_4 = GhPythonScript(x=number_slider_3, y=number_slider_3)  # -> out, a
# ---------- python_4: Python ----------
import rhinoscriptsyntax as rs

def addition(x1,x2):
    sum=x1+x2
    return sum 

def numbers():
    x1=x
    x2=y
    return x1, x2

print(addition(x1,x2))
# ---------- end python_4 ----------
